# Dynamo graph pieces_get.dyn (Dynamo 1.2.1.3083)

# group: UI
code_block = CodeBlock { "Excel File"; }
code_block_2 = CodeBlock { "fp"; }
code_block_3 = CodeBlock { true; }
multipleInputForm = Custom[UI.MultipleInputForm](InputNames=code_block, InputTypes_see_description=code_block_2, Toggle=code_block_3)  # Create a form with multiple inputs. InputType codification: -strings : "s" -booleans : "bool" -filepaths : "fp" -directorypath : "dp" -revit element section : "se" -revit face selection : "sf" -revit edge selection : "sed" -dropdown lists : UI.DropDown Data node -listview : UI.ListView Data node see www.data-shapes.net for more infos

# group: PIECES
categories = Categories("Rooms")
all_elements_of_category = ElementsOfCategory(categories)

# group: NOM
string = StringInput("Nom")
getParameterValueByName = Element.GetParameterValueByName(element=all_elements_of_category, parameterName=string)

# group: ID
id = Element.Id(all_elements_of_category)

# group: NIVEAU
string_2 = StringInput("Niveau")
getParameterValueByName_2 = Element.GetParameterValueByName(element=all_elements_of_category, parameterName=string_2)

# group: SURFACE
string_3 = StringInput("Surface")
getParameterValueByName_3 = Element.GetParameterValueByName(element=all_elements_of_category, parameterName=string_3)
number = DoubleInput(2)
round = Math.Round(number=getParameterValueByName_3, digits=number)

# group: PERIMETRE
string_4 = StringInput("Périmètre")
getParameterValueByName_4 = Element.GetParameterValueByName(element=all_elements_of_category, parameterName=string_4)
number_2 = DoubleInput(2)
round_2 = Math.Round(number=getParameterValueByName_4, digits=number_2)

# group: FINITION DU SOL
string_5 = StringInput("Finition du sol")
getParameterValueByName_5 = Element.GetParameterValueByName(element=all_elements_of_category, parameterName=string_5)

# group: FINITION DU MUR
string_6 = StringInput("Finition du mur")
getParameterValueByName_6 = Element.GetParameterValueByName(element=all_elements_of_category, parameterName=string_6)

# group: FINITION DU PLAFOND
string_7 = StringInput("Finition du plafond")
getParameterValueByName_7 = Element.GetParameterValueByName(element=all_elements_of_category, parameterName=string_7)

# group: FINITION DE LA BASE
string_8 = StringInput("Finition de la base")
getParameterValueByName_8 = Element.GetParameterValueByName(element=all_elements_of_category, parameterName=string_8)

# group: SERVICE
string_9 = StringInput("Service")
getParameterValueByName_9 = Element.GetParameterValueByName(element=all_elements_of_category, parameterName=string_9)

# group: DATA
create = List.Create(getParameterValueByName, id, getParameterValueByName_2, round, round_2, getParameterValueByName_5, getParameterValueByName_6, getParameterValueByName_7, getParameterValueByName_8, getParameterValueByName_9)
transpose = List.Transpose(create)

# group: EXCEL
code_block_4 = CodeBlock { "Pièces"; }
code_block_5 = CodeBlock { 0; }
code_block_6 = CodeBlock { {"Nom","Id","Niveau","Surface","Périmiètre","Finition du sol","Finition du mur","Finition du plafond", "Finition de la base","Service"}; }
addItemToFront = List.AddItemToFront(item=code_block_6, list=transpose)
code_block_7 = CodeBlock { true; }
writeToFile = Excel.WriteToFile(filePath=multipleInputForm.User_inputs, sheetName=code_block_4, startRow=code_block_5, startCol=code_block_5, data=addItemToFront, overWrite=code_block_7)
