# Dynamo graph pieces_set.dyn (Dynamo 1.2.1.3083)

# group: UI
code_block = CodeBlock { "FilePath"; }
code_block_2 = CodeBlock { "fp"; }
code_block_3 = CodeBlock { true; }
multipleInputForm = Custom[UI.MultipleInputForm](InputNames=code_block, InputTypes_see_description=code_block_2, Toggle=code_block_3)  # Create a form with multiple inputs. InputType codification: -strings : "s" -booleans : "bool" -filepaths : "fp" -directorypath : "dp" -revit element section : "se" -revit face selection : "sf" -revit edge selection : "sed" -dropdown lists : UI.DropDown Data node -listview : UI.ListView Data node see www.data-shapes.net for more infos

# group: EXCEL
fromPath = FileObject(multipleInputForm.User_inputs)  # "File.FromPath"
code_block_4 = CodeBlock { "Pièces"; }
code_block_5 = CodeBlock { true; }
readFromFile = Excel.ReadFromFile(file=fromPath, sheetName=code_block_4, readAsStrings=code_block_5)
code_block_6 = CodeBlock { 1; }
flatten = List.Flatten(list=readFromFile, amt=code_block_6)
code_block_7 = CodeBlock { 0; }
removeItemAtIndex = List.RemoveItemAtIndex(list=flatten, indices=code_block_7)
transpose = List.Transpose(removeItemAtIndex)

# group: ID to ELEMENT
code_block_8 = CodeBlock { 1; }
getItemAtIndex = List.GetItemAtIndex(list=transpose, index=code_block_8)
byElementId = Archilab.Grimshaw.Selection.Select.ByElementId(getItemAtIndex)

# group: NOM
string = StringInput("Nom")
code_block_9 = CodeBlock { 0; }
getItemAtIndex_2 = List.GetItemAtIndex(list=transpose, index=code_block_9)
setParameterByName = Element.SetParameterByName(element=byElementId, parameterName=string, value=getItemAtIndex_2)

# group: FINITION DU SOL
string_2 = StringInput("Finition du sol")
code_block_10 = CodeBlock { 5; }
getItemAtIndex_3 = List.GetItemAtIndex(list=transpose, index=code_block_10)
setParameterByName_2 = Element.SetParameterByName(element=byElementId, parameterName=string_2, value=getItemAtIndex_3)

# group: FINITION DU MUR
string_3 = StringInput("Finition du mur")
code_block_11 = CodeBlock { 6; }
getItemAtIndex_4 = List.GetItemAtIndex(list=transpose, index=code_block_11)
setParameterByName_3 = Element.SetParameterByName(element=byElementId, parameterName=string_3, value=getItemAtIndex_4)

# group: FINITION DU PLAFOND
string_4 = StringInput("Finition du plafond")
code_block_12 = CodeBlock { 7; }
getItemAtIndex_5 = List.GetItemAtIndex(list=transpose, index=code_block_12)
setParameterByName_4 = Element.SetParameterByName(element=byElementId, parameterName=string_4, value=getItemAtIndex_5)

# group: FINITION DE LA BASE
string_5 = StringInput("Finition de la base")
code_block_13 = CodeBlock { 8; }
getItemAtIndex_6 = List.GetItemAtIndex(list=transpose, index=code_block_13)
setParameterByName_5 = Element.SetParameterByName(element=byElementId, parameterName=string_5, value=getItemAtIndex_6)

# group: SERVICE
string_6 = StringInput("Service")
code_block_14 = CodeBlock { 9; }
getItemAtIndex_7 = List.GetItemAtIndex(list=transpose, index=code_block_14)
setParameterByName_6 = Element.SetParameterByName(element=byElementId, parameterName=string_6, value=getItemAtIndex_7)
