# Dynamo graph rename_get.dyn (Dynamo 1.2.1.3083)

# group: FAMILLES CHARGEABLES
familles_chargeables = Python()  # unwired: IN[0]
# ---------- familles_chargeables.python (42 lines) ----------
import clr

# Import RevitAPI
clr.AddReference("RevitAPI")
import Autodesk
from Autodesk.Revit.DB import *

clr.AddReference("RevitUIAPI")

# Import DocumentManager and TransactionManager
clr.AddReference("RevitServices")
import RevitServices
from RevitServices.Persistence import DocumentManager
from RevitServices.Transactions import TransactionManager

# Import ToDSType(bool) extension method
clr.AddReference("RevitNodes")
import Revit
clr.ImportExtensions(Revit.Elements)
clr.ImportExtensions(Revit.GeometryConversion)

import System

import sys
#Les entrées effectuées dans ce noeud sont stockées sous forme de liste dans les variables IN.
dataEnteringNode = IN

doc =  DocumentManager.Instance.CurrentDBDocument
app =  DocumentManager.Instance.CurrentUIApplication.Application



cats=[BuiltInCategory.OST_PipeFitting, BuiltInCategory.OST_PipeAccessory, BuiltInCategory.OST_DuctFitting, BuiltInCategory.OST_DuctAccessory, BuiltInCategory.OST_DuctTerminal, BuiltInCategory.OST_ElectricalEquipment, BuiltInCategory.OST_MechanicalEquipment, BuiltInCategory.OST_CableTrayFitting, BuiltInCategory.OST_ConduitFitting, BuiltInCategory.OST_Sprinklers]
a=[]

#cat = doc.Settings.Categories.get_Item(BuiltInCategory.OST_DuctTerminal)

for cat in cats:
	a.append(Revit.Elements.Category.ById(doc.Settings.Categories.get_Item(cat).Id.IntegerValue))
	
OUT = a
#Revit.Elements.Category.ById(cat.Id.IntegerValue)
# ----------------------------------------
all_elements_of_category = ElementsOfCategory(familles_chargeables)
flatten = Flatten(all_elements_of_category)
type = FamilyInstance.Type(flatten)
family = FamilyType.Family(type)
name = Element.Name(family)
uniqueItems = List.UniqueItems(name)
id = Element.Id(family)
uniqueItems_2 = List.UniqueItems(id)
create = List.Create(uniqueItems, uniqueItems_2)

# group: EXCEL
code_block = CodeBlock { 0; }
code_block_2 = CodeBlock { true; }
transpose = List.Transpose(create)
file_path = Filename("C:\Users\jose-ignacio.gil-urr\Desktop\Renommage.xlsx")
code_block_3 = CodeBlock { "Chargeables"; }

# group: BUMBLEBEE
code_block_4 = CodeBlock { true; }
code_block_5 = CodeBlock { true; }
code_block_6 = CodeBlock { "A1"; }
# note: Archi-lab_Bumblebee
bb_data = Custom[BB Data](SheetName=code_block_3, Origin=code_block_6, Data=create)  # This node is a building block for different modes of writing to Excel files. You can combines this node into a list to write to multiple sheets or use just one to write to a single sheet.
write_excel = Custom[Write Excel](filePath=file_path, RunIt=code_block_4, ByColumn=code_block_5, BBData=bb_data)  # This node will write data to Excel file and based on how your BBData nodes are structured it will either override the exsting file, create a new one and write a single worksheet or write multiple worksheets.
