# Dynamo graph rename_set.dyn (Dynamo 1.2.1.3083)

# group: EXCEL
file_path = Filename("C:\Users\jose-ignacio.gil-urr\Desktop\Renommage.xlsx")
fromPath = FileObject(file_path)  # "File.FromPath"
code_block = CodeBlock { "Chargeable"; }
code_block_2 = CodeBlock { true; }
readFromFile = Excel.ReadFromFile(file=fromPath, sheetName=code_block, readAsStrings=code_block_2)
transpose = List.Transpose(readFromFile)

# group: ID
code_block_3 = CodeBlock { 1; }
getItemAtIndex = List.GetItemAtIndex(list=transpose, index=code_block_3)
toNumber = String.ToNumber(getItemAtIndex)
byElementId = Archilab.Grimshaw.Selection.Select.ByElementId(toNumber)

# group: NOM
code_block_4 = CodeBlock { 0; }
getItemAtIndex_2 = List.GetItemAtIndex(list=transpose, index=code_block_4)

# group: SET
setName = Custom[Element.SetName](element=byElementId, name=getItemAtIndex_2)  # Gets the name of a given Revit element
