# Dynamo graph shared_parameter.dyn (Dynamo 1.2.1.3083)

sharedParamterFileContent = Python()  # unwired: IN[0]
# ---------- sharedParamterFileContent.python (46 lines) ----------
import clr

# Import RevitAPI
clr.AddReference("RevitAPI")
import Autodesk
from Autodesk.Revit.DB import *

clr.AddReference("RevitUIAPI")

# Import DocumentManager and TransactionManager
clr.AddReference("RevitServices")
import RevitServices
from RevitServices.Persistence import DocumentManager
from RevitServices.Transactions import TransactionManager

# Import ToDSType(bool) extension method
clr.AddReference("RevitNodes")
import Revit
clr.ImportExtensions(Revit.Elements)
clr.ImportExtensions(Revit.GeometryConversion)

import Autodesk.Revit.DB.XYZ
import math
import System
from System import Array
from System.Collections.Generic import *

import sys
sys.path.append("C:\\Program Files (x86)\\IronPython 2.7\\Lib\\")
import os
doc =  DocumentManager.Instance.CurrentDBDocument
app =  DocumentManager.Instance.CurrentUIApplication.Application
pp = Autodesk.Revit.ApplicationServices.Application.OpenSharedParameterFile (app)

myGroups = pp.Groups

b = list()
a = list()
for y in myGroups:
    b.append(y.Name)
    for x in y.Definitions:
        a.append(x.Name)
            
#SharedParameterElement.Create(doc, Name='parmaext1',ParameterGroup='G1',ParameterType='Number')

OUT = a
# ----------------------------------------
string = StringInput("ART_Ai extremite_NGF")
python_script = Python(IN[0]=sharedParamterFileContent, IN[1]=string)
# ---------- python_script.python (16 lines) ----------
import clr
clr.AddReference('ProtoGeometry')
from Autodesk.DesignScript.Geometry import *
#Les entrées effectuées dans ce noeud sont stockées sous forme de liste dans les variables IN.
dataEnteringNode = IN

test=0

for x in IN[0]:
	if x == IN[1] :
		test=1
		break
	else:
		test=0
#Affectez la sortie à la variable OUT.
OUT = test, IN[1]
# ----------------------------------------
string_2 = StringInput("ART_Ai extremite")
python_script_2 = Python(IN[0]=sharedParamterFileContent, IN[1]=string_2)  # same code as python_script
string_3 = StringInput("ART_Ai depart_NGF")
python_script_3 = Python(IN[0]=sharedParamterFileContent, IN[1]=string_3)
# ---------- python_script_3.python (16 lines) ----------
import clr
clr.AddReference('ProtoGeometry')
from Autodesk.DesignScript.Geometry import *
#Les entrées effectuées dans ce noeud sont stockées sous forme de liste dans les variables IN.
dataEnteringNode = IN

test=0

for x in IN[0]:
	if x.Contains(IN[1]) :
		test=1
		break
	else:
		test=0
#Affectez la sortie à la variable OUT.
OUT = test, IN[1]
# ----------------------------------------
string_4 = StringInput("ART_Ai depart")
sharedParameterInSharedParameterFile = Python(IN[0]=sharedParamterFileContent, IN[1]=string_4)  # "Test.SharedParameterInSharedParameterFile"; same code as python_script
